# Grasshopper definition UrbanBlock_CAADRIA2022.gh (Grasshopper 1.0.7)
# plug-ins: LunchBox

# TYPOLOGY
topology = Slider(1, range=1..5)
typology = Slider(2, range=1..5)
typology_2 = Slider(2, range=1..5)
domain = Domain(Domain(0, 20))
range = Range(Domain=domain, Steps=10)

curve = Curve(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)
offset = Offset(Curve=curve, Distance=Slider(8, range=0..8), Plane=PlaneXY(0, 0, 0), Corners=1)
explode = Explode(Curve=offset, Recursive=True)  # -> Segments, Vertices
divide_distance = DivideDistance(Curve=explode.Segments, Distance=Slider(3.6, range=0..8))  # -> Points, Tangents, Parameters
boundary_surfaces = BoundarySurfaces(Edges=curve)
boundary_surfaces_2 = BoundarySurfaces(Edges=offset)
curve_closest_point = CurveClosestPoint(Point=divide_distance.Points, Curve=curve)  # -> Point, Parameter, Distance
region_difference = RegionDifference(CurvesA=boundary_surfaces, CurvesB=boundary_surfaces_2)
line = Line(StartPoint=curve_closest_point.Point, EndPoint=divide_distance.Points)
boundary_surfaces_3 = BoundarySurfaces(Edges=region_difference)
surface_split = SurfaceSplit(Surface=boundary_surfaces_3, Curves=flatten(line))
number_slider = Slider(7, range=0..10)
random_split_list = RandomSplitList(MasterList=surface_split, Seed=typology_2, Split=0.5)  # -> ListA, ListB
unit_z = UnitZ(Factor=range)
area = Area(Geometry=random_split_list.ListB)  # -> Area, Centroid
extrude = Extrude(Base=random_split_list.ListB, Direction=unit_z)

end_points = EndPoints(Curve=boundary_surfaces_2)  # -> Start, End
point = Point(end_points.End)

# ----
# TREES
# TREES
number_slider_2 = Slider(3, range=1..10)
point_2 = Point(Point(38.06885362, 25.65718419, 2.494824623))
point_3 = Point(Point(32.40271467, 15.56611557, 1.595184394))
sphere = Sphere(Base=point_2, Radius=number_slider_2)
sphere_2 = Sphere(Base=point_3, Radius=Slider(2, range=1..10))
merge = Merge(Data1=sphere, Data2=sphere_2)
geometry = Geometry(merge)

nx = Slider(7, range=0..50)
dx = Slider(1.7, range=0..10)
ny = Slider(3, range=0..50)
dy = Slider(5.62, range=0..10)
start_angle = Slider(106.97, range=0..720)
end_angle = Slider(2982.61, range=0..10000)

# ----
# BUILDINGS
geometry_2 = Geometry(extrude)

series = Series(Start=0, Step=dx, Count=nx)
xy = XYPlane(Origin=point)
X = UnitX(Factor=series)
move = Move(Geometry=xy, Motion=X)  # -> Geometry, Transform

# ----
# BENCHES
geometry_3 = Geometry(boundary_surfaces_2)
X_2 = Slider(3.76, range=0..10)
Y = Slider(0.8, range=0..10)
Z = Slider(0.6, range=0..10)
area_2 = Area(Geometry=geometry_3)  # -> Area, Centroid
pt = Point(area_2.Centroid)
expression = Expression(nx=nx, ny=ny, Expression="nx * ny - 1")
series_2 = Series(Start=0, Step=dy, Count=ny)
dom = ConstructDomain(DomainStart=start_angle, DomainEnd=end_angle)
Y_2 = UnitY(Factor=series_2)
range_2 = Range(Domain=dom, Steps=expression)
rad = Radians(Degrees=range_2)
graft = GraftTree(Tree=move.Geometry, IncludeEmptyLists=True, IncludeNullItems=True)
move_2 = Move(Geometry=graft, Motion=Y_2)  # -> Geometry, Transform
flatten = FlattenTree(Tree=move_2.Geometry, Path="{0}")
rotate = Rotate(Geometry=flatten, Angle=rad, Plane=flatten)  # -> Geometry, Transform

# ----
# Programme
# Year of Construction
# Materiality
# Structural System
point_list = PointList(Points=area.Centroid, Size=Slider(1, range=0..10))
panel = Panel("""residential
office
commercial
mixed""")
lng = ListLength(List=geometry_2)

expression_2 = Expression(d=X_2, Expression="- 0.5 * d")
expression_3 = Expression(d=Y, Expression="- 0.5 * d")
expression_4 = Expression(d=X_2, Expression="0.5 * d")
expression_5 = Expression(d=Y, Expression="0.5 * d")
dom_2 = ConstructDomain(DomainStart=expression_2, DomainEnd=expression_4)
dom_3 = ConstructDomain(DomainStart=expression_3, DomainEnd=expression_5)
box = DomainBox(Base=rotate.Geometry, X=dom_2, Y=dom_3, Z=Z)

repeat = RepeatData(Data=panel, Length=lng)
jitter = Jitter(List=repeat, Jitter=1, Seed=2)  # -> graft(Values), Indices
graft_2 = GraftTree(Tree=geometry_2, IncludeEmptyLists=True, IncludeNullItems=True)

list_item = ListItem(List=geometry_2, Index=Slider(15, range=0..100), Wrap=True)
deconstruct_brep = DeconstructBrep(Brep=list_item)  # -> Faces, Edges, Vertices
geometry_4 = Geometry(deconstruct_brep.Faces)
list_item_2 = ListItem(List=geometry_4, Index=Slider(2, range=1..6), Wrap=True)
list_item_3 = ListItem(List=geometry_4, Index=Slider(3, range=1..6), Wrap=True)
# GLAZING
geometry_5 = Geometry([list_item_3, list_item_2])

entwine = Entwine(Branch00=graft_2, Branch01=jitter.Values, FlattenInputs=True)
simplify = SimplifyTree(Tree=entwine, Front=False)
flip = FlipMatrix(Data=simplify)
branch = TreeBranch(Tree=flip, Path=Slider(15, range=0..15), MaintainPaths=True)
# BENCHES
geometry_6 = Geometry(box)
panel_2 = Panel(branch)

# ----
# BRICK WALL (HEAVY)
pt_2 = Point(pt)
nh = Slider(11, range=0..25)
nv = Slider(18, range=0..25)
w = Slider(0.8, range=0..1)
h = Slider(0.2, range=0..1)
d = Slider(0.4, range=0..1)
mortar_thickness = Slider(0.02, range=0..0.2)

point_4 = Point(Point(5.5, 14.77535334, 0))

time = Slider(0, range=0..25)
pt_3 = Point(pt_2)
xy_2 = XYPlane(Origin=point_4)

expression_6 = Expression(w=w, nh=nh, Expression="w * (nh - 0.5)")
expression_7 = Expression(x=nv, Expression="Floor(0.5 * x)")
expression_8 = Expression(x=w, Expression="-0.25 * x")
expression_9 = Expression(x=h, Expression="2 * x")
series_3 = Series(Start=0, Step=expression_6, Count="2")
vec = VectorXYZ(XComponent=expression_8, YComponent=0, ZComponent=h)  # -> Vector, Length
series_4 = Series(Start=0, Step=expression_9, Count=expression_7)
move_3 = Move(Geometry=xy_2, Motion=vec.Vector)  # -> Geometry, Transform
Z_2 = UnitZ(Factor=series_4)
X_3 = UnitX(Factor=series_3)
graft_3 = GraftTree(Tree=Z_2, IncludeEmptyLists=True, IncludeNullItems=True)
move_4 = Move(Geometry=move_3.Geometry, Motion=X_3)  # -> Geometry, Transform
move_5 = Move(Geometry=move_4.Geometry, Motion=graft_3)  # -> Geometry, Transform

expression_10 = Expression(x=nv, Expression="Floor(0.5 * x)")
expression_11 = Expression(x=w, Expression="0.5 * x")
expression_12 = Expression(x=nh, Expression="X - 1")
expression_13 = Expression(x=h, Expression="2 * x")
vec_2 = VectorXYZ(XComponent=expression_11, YComponent=0, ZComponent=h)  # -> Vector, Length
series_5 = Series(Start=0, Step=w, Count=expression_12)
series_6 = Series(Start=0, Step=expression_13, Count=expression_10)
move_6 = Move(Geometry=xy_2, Motion=vec_2.Vector)  # -> Geometry, Transform
Z_3 = UnitZ(Factor=series_6)
X_4 = UnitX(Factor=series_5)
move_7 = Move(Geometry=move_6.Geometry, Motion=X_4)  # -> Geometry, Transform
graft_4 = GraftTree(Tree=Z_3, IncludeEmptyLists=True, IncludeNullItems=True)
move_8 = Move(Geometry=move_7.Geometry, Motion=graft_4)  # -> Geometry, Transform

expression_14 = Expression(x=nv, Expression="0.5 * x")
expression_15 = Expression(x=h, Expression="2 * x")
series_7 = Series(Start=0, Step=expression_15, Count=expression_14)
series_8 = Series(Start=0, Step=w, Count=nh)
Z_4 = UnitZ(Factor=series_7)
X_5 = UnitX(Factor=series_8)
graft_5 = GraftTree(Tree=Z_4, IncludeEmptyLists=True, IncludeNullItems=True)
move_9 = Move(Geometry=xy_2, Motion=X_5)  # -> Geometry, Transform
move_10 = Move(Geometry=move_9.Geometry, Motion=graft_5)  # -> Geometry, Transform

panel_3 = Panel(move_10.Geometry)
base_brick_planes = Plane(move_10.Geometry)
central_brick_planes = Plane(move_8.Geometry)
edge_brick_planes = Plane(move_5.Geometry)

pln = Plane(flatten([base_brick_planes, central_brick_planes]))
pln_2 = Plane(flatten(edge_brick_planes))
vec2pt = Vector2Pt(PointA=pt_3, PointB=pln, Unitize=False)  # -> Vector, Length
vec2pt_2 = Vector2Pt(PointA=pt_3, PointB=pln_2, Unitize=False)  # -> Vector, Length
expression_16 = Expression(x=vec2pt.Length, Expression="1 / x")
expression_17 = Expression(x=vec2pt_2.Length, Expression="1 / x")
multiplication = Multiplication(A=time, B=expression_16)
multiplication_2 = Multiplication(A=time, B=expression_17)
amp = Amplitude(Vector=vec2pt.Vector, Amplitude=multiplication)
amp_2 = Amplitude(Vector=vec2pt_2.Vector, Amplitude=multiplication_2)
move_11 = Move(Geometry=pln, Motion=amp)  # -> Geometry, Transform
move_12 = Move(Geometry=pln_2, Motion=amp_2)  # -> Geometry, Transform

number_slider_3 = Slider(286, range=0..1000)
expression_18 = Expression(x=number_slider_3, Expression="x + 1")
expression_19 = Expression(x=number_slider_3, Expression="x + 2")
lng_2 = ListLength(List=move_12.Geometry)
random = Random(Range="-1 To 1", Number=lng_2, Seed=number_slider_3)
random_2 = Random(Range="-1 To 1", Number=lng_2, Seed=expression_18)
random_3 = Random(Range="-1 To 1", Number=lng_2, Seed=expression_19)
vec_3 = VectorXYZ(XComponent=random, YComponent=random_2, ZComponent=random_3)  # -> Vector, Length
deplane = DeconstructPlane(Plane=move_12.Geometry)  # -> Origin, XAxis, YAxis, ZAxis
rot3d = Rotate3D(Geometry=move_12.Geometry, Angle=multiplication_2, Center=deplane.Origin, Axis=vec_3.Vector)  # -> Geometry, Transform

number_slider_4 = Slider(286, range=0..1000)
expression_20 = Expression(x=number_slider_4, Expression="x + 1")
expression_21 = Expression(x=number_slider_4, Expression="x + 2")
lng_3 = ListLength(List=move_11.Geometry)
random_4 = Random(Range="-1 To 1", Number=lng_3, Seed=number_slider_4)
random_5 = Random(Range="-1 To 1", Number=lng_3, Seed=expression_20)
random_6 = Random(Range="-1 To 1", Number=lng_3, Seed=expression_21)
vec_4 = VectorXYZ(XComponent=random_4, YComponent=random_5, ZComponent=random_6)  # -> Vector, Length
deplane_2 = DeconstructPlane(Plane=move_11.Geometry)  # -> Origin, XAxis, YAxis, ZAxis
rot3d_2 = Rotate3D(Geometry=move_11.Geometry, Angle=multiplication, Center=deplane_2.Origin, Axis=vec_4.Vector)  # -> Geometry, Transform

expression_22 = Expression(x=d, y=mortar_thickness, Expression="(x - y) / 2")
expression_23 = Expression(x=h, y=mortar_thickness, Expression="(x - y) / 2")
expression_24 = Expression(x=w, y=mortar_thickness, Expression="(x - y) / 2")
box_2 = CenterBox(Base=rot3d_2.Geometry, X=expression_24, Y=expression_22, Z=expression_23)

expression_25 = Expression(x=w, y=mortar_thickness, Expression="(x - 2 * y) / 4")
expression_26 = Expression(x=d, y=mortar_thickness, Expression="(x - y) / 2")
expression_27 = Expression(x=h, y=mortar_thickness, Expression="(x - y) / 2")
box_3 = CenterBox(Base=rot3d.Geometry, X=expression_25, Y=expression_26, Z=expression_27)

# ----
# BRICK WALL
rotate_2 = Rotate(Geometry=box_2, Angle=degrees(Slider(89, range=0..100)), Plane=point_4)  # -> Geometry, Transform
geometry_7 = Geometry(rotate_2.Geometry)
